# Grasshopper definition Beneficial Daylight for Facades Analysis Tool.gh (Grasshopper 1.0.6)

# ----
# XIM Standards
# Inputs
data = Data(True)

# ---- group: January
domain_sunrise_sunset = Domain(Domain(7.358, 16.8814))
crv_sun_path = Curve(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)

# ---- group: July
domain_sunrise_sunset_2 = Domain(Domain(4.7717, 19.3044))
crv_sun_path_2 = Curve(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)

# ----
brep_building = Brep([<brep referenced from the Rhino model> x18])
mesh_context = Mesh([<mesh referenced from the Rhino model> x768])
analysis_resolution = Panel("50")
winter_sunlight_hrs_threshold = Panel("3")
summer_sunlight_hrs_threshold = Panel("6")

# ----
# Ouputs
data_2 = Data(True)

sunion = SolidUnion(Breps=brep_building)

# ----
# Merge Context and Buildings
mesh = Mesh(brep_building)
merge = Merge(Data1=mesh_context, Data2=mesh)
# DO NOT CHANGE
mjoin = MeshJoin(Meshes=merge)

# ----
# Note
# Actions
# Previews
note_panel = Panel("")

subdivision = Subdivision(brep=sunion, num=analysis_resolution)  # -> G, N, G_2, srf_horizontal_2
cluster = Cluster(
    srf_sub_srf=subdivision.G,
    sample_points=subdivision.G_2,
    context_mesh=mjoin,
    crv_winter_sun_path=crv_sun_path,
    domain_winter_sun=domain_sunrise_sunset,
    crv_summer_sun_path=crv_sun_path_2,
    domain_summer_sun=domain_sunrise_sunset_2,
    int_winter_sunlight_hrs_threshold=winter_sunlight_hrs_threshold,
    int_summer_sunlight_hrs_threshold=summer_sunlight_hrs_threshold)  # -> mesh_4, num_mesh_values_for_scout_2, num_mesh_values_for_scout_winter_sunligh_2, num_mesh_values_for_scout_summer_shadow_2, sustainable_facade_percentage_2
srf_horizontal = Surface(subdivision.srf_horizontal_2)

# ----
# Sustainable Facade Percentage:
# 
# % of facade that meet both requirements:
# 1. Winter Sun > 3 hr/day
# 2. Summer Sun < 6 hr/day
sustainable_facade_percentage = Panel(cluster.sustainable_facade_percentage_2)

mesh_analysis = Mesh(cluster.mesh_4)

# ----
# Previews
srf_horizontal_2 = Surface(srf_horizontal)
preview = CustomPreview(Geometry=srf_horizontal_2, Material=ColourSwatch(SwatchColor=RGB(255, 255, 255)))

num_mesh_values_for_scout_composite_sust = Number(cluster.num_mesh_values_for_scout_2)  # "Num:Mesh Values for Scout (Composite Sustainable Degree)"
num_mesh_values_for_scout_winter_sunligh = Number(cluster.num_mesh_values_for_scout_winter_sunligh_2)  # "Num:Mesh Values for Scout (Winter Sunlight Hr)"
num_mesh_values_for_scout_summer_shadow = Number(cluster.num_mesh_values_for_scout_summer_shadow_2)  # "Num:Mesh Values for Scout (Summer Shadow Hr)"
num_sustainable_facade_percentage = Number(cluster.sustainable_facade_percentage_2)
mesh_analysis_2 = Number(mesh_analysis)

# ==== cluster Subdivision
brep = ClusterInput()
num = ClusterInput()

# ---- group: Remove top and bot
brep_2 = Brep(brep)
debrep = DeconstructBrep(Brep=brep_2)  # -> Faces, Edges, Vertices
evalsrf = EvaluateSurface(Surface=reparameterize(debrep.Faces), Point="0.5,0.5,0")  # -> Point, Normal, UDirection, VDirection, Frame
devec = DeconstructVector(Vector=evalsrf.Normal)  # -> XComponent, YComponent, ZComponent
abs = Absolute(Value=devec.ZComponent)
smaller = SmallerThan(FirstNumber=abs, SecondNumber=Slider(0.95, range=0..0.95))  # -> SmallerThan, OrEqualTo
dispatch = Dispatch(List=debrep.Faces, DispatchPattern=smaller.SmallerThan)  # -> ListA, ListB

# ----
num_2 = Number(num)
brep_3 = Brep(brep_2)
srf = Surface(dispatch.ListB)
srf_horizontal = Surface(srf)
srf_horizontal_2 = ClusterOutput(srf_horizontal)

# ---- group: Sub divide Srf
srf_2 = Surface(graft(dispatch.ListA))
dim = Dimensions(Surface=srf_2)  # -> UDimension, VDimension
division = Division(A=dim.VDimension, B=num_2)
division_2 = Division(A=dim.UDimension, B=num_2)

# ----
eval = Evaluate(F="if(x<1,1,x)", x=division_2)
eval_2 = Evaluate(F="if(x<1,1,x)", x=division)
panel = Panel(srf_2)

# ---- group: Sub divide Srf (continued)
divide = DivideDomain²(Domain=srf_2, UCount=eval, VCount=eval_2)
subsrf = Isotrim(Surface=srf_2, Domain=divide)
evalsrf_2 = EvaluateSurface(Surface=reparameterize(subsrf), Point="0.5,0.5,0")  # -> simplify(Point), simplify(Normal), UDirection, VDirection, Frame

# ----
amp = Amplitude(Vector=evalsrf_2.Normal, Amplitude=Slider(1, range=0..1))
move = Move(Geometry=evalsrf_2.Point, Motion=amp)  # -> Geometry, Transform
brepsinc = PointInBreps(Brep=brep_3, Point=move.Geometry, Strict=False)  # -> Inside, Index
dispatch_2 = Dispatch(List=subsrf, DispatchPattern=brepsinc.Inside)  # -> ListA, ListB
flip = Flip(Surface=dispatch_2.ListA)  # -> Surface, Result
merge = Merge(Data1=flip.Surface, Data2=dispatch_2.ListB)  # -> simplify(Result)
evalsrf_3 = EvaluateSurface(Surface=reparameterize(merge), Point="0.5,0.5,0")  # -> simplify(Point), simplify(Normal), UDirection, VDirection, Frame
amp_2 = Amplitude(Vector=evalsrf_3.Normal, Amplitude=Slider(0.3, range=0..1))
move_2 = Move(Geometry=merge, Motion=amp_2)  # -> Geometry, Transform
move_3 = Move(Geometry=evalsrf_3.Point, Motion=amp_2)  # -> Geometry, Transform
G = ClusterOutput(move_2.Geometry)
N = ClusterOutput(evalsrf_3.Normal)
G_2 = ClusterOutput(move_3.Geometry)

# ==== cluster Cluster
int_summer_sunlight_hrs_threshold = ClusterInput()
int_winter_sunlight_hrs_threshold = ClusterInput()
domain_winter_sun = ClusterInput()
crv_summer_sun_path = ClusterInput()
domain_summer_sun = ClusterInput()
crv_winter_sun_path = ClusterInput()
sample_points = ClusterInput()
context_mesh = ClusterInput()
srf_sub_srf = ClusterInput()
int_summer_sunlight_hrs_threshold_2 = Integer(int_summer_sunlight_hrs_threshold)
int_winter_sunlight_hrs_threshold_2 = Integer(int_winter_sunlight_hrs_threshold)
crv_summer_sun_path_2 = Curve(crv_summer_sun_path)
domain_summer_sun_2 = Domain(domain_summer_sun)
domain_winter_sun_2 = Domain(domain_winter_sun)
crv_winter_sun_path_2 = Curve(crv_winter_sun_path)
sample_points_2 = Point(sample_points)
context_mesh_2 = Mesh(context_mesh)
srf_sub_srf_2 = Surface(srf_sub_srf)
sun_light_hrs = SunLightHrs(pt=sample_points_2, mesh=context_mesh_2, crv=crv_winter_sun_path_2, domain=domain_winter_sun_2)
sun_light_hrs_2 = SunLightHrs(pt=sample_points_2, mesh=context_mesh_2, crv=crv_summer_sun_path_2, domain=domain_summer_sun_2)
mesh = MeshBrep(
    Brep=srf_sub_srf_2,
    Settings={GridMaxCount=0, GridMinCount=16, JaggedSeams=False, MaxEdgeLength=0, MinEdgeLength=0.0001, MinTolerance=0, Refine=True, RefineAngle=0, RelativeTolerance=0.65, SimplePlanes=True, Tolerance=0})
dedomain = DeconstructDomain(Domain=domain_summer_sun_2)  # -> Start, End
subtraction = Subtraction(A=dedomain.End, B=dedomain.Start)
smaller = SmallerThan(FirstNumber=flatten(sun_light_hrs_2), SecondNumber=int_summer_sunlight_hrs_threshold_2)  # -> SmallerThan, OrEqualTo
larger = LargerThan(FirstNumber=flatten(sun_light_hrs), SecondNumber=int_winter_sunlight_hrs_threshold_2)  # -> LargerThan, OrEqualTo
summer_sun_light_hrs = Number(sun_light_hrs_2)
winter_sun_light_hrs = Number(sun_light_hrs)
mesh_2 = Mesh(mesh)
summer_day_hrs = Number(subtraction)
and = GateAnd(A=larger.OrEqualTo, B=smaller.OrEqualTo)
subtraction_2 = Subtraction(A=summer_sun_light_hrs, B=summer_day_hrs)
expression = Expression(x=winter_sun_light_hrs, y=summer_sun_light_hrs, Expression="x-y+10")
ma = MassAddition(Input=and)  # -> Result, PartialResults
lng = ListLength(List=and)
bnd = Bounds(Numbers=flatten(expression))
dedomain_2 = DeconstructDomain(Domain=bnd)  # -> Start, End
division = Division(A=ma.Result, B=lng)
gradient = Gradient(
    LowerLimit=dedomain_2.Start,
    UpperLimit=dedomain_2.End,
    Parameter=expression,
    stops=[0: RGB(0, 77, 128), 0.5: RGB(255, 255, 0), 1: RGB(255, 0, 0)])
neg = Negative(Value=subtraction_2)
col = Colour(graft(gradient))
num_mesh_values_for_scout_summer_shadow = Number(simplify(graft(neg)))
num_mesh_values_for_scout_winter_sunligh = Number(simplify(graft(winter_sun_light_hrs)))  # "Num:Mesh Values for Scout (Winter Sunlight)"
mcol = MeshColours(Mesh=graft(mesh_2), Colours=graft(col))  # -> simplify(Mesh)
num_mesh_values_for_scout = Number(simplify(graft(expression)))
sustainable_facade_percentage = Number(division)
mesh_3 = Mesh(mcol)
mesh_4 = ClusterOutput(mesh_3)
num_mesh_values_for_scout_2 = ClusterOutput(num_mesh_values_for_scout)
num_mesh_values_for_scout_winter_sunligh_2 = ClusterOutput(num_mesh_values_for_scout_winter_sunligh)  # "Num:Mesh Values for Scout (Winter Sunlight)"
num_mesh_values_for_scout_summer_shadow_2 = ClusterOutput(num_mesh_values_for_scout_summer_shadow)
sustainable_facade_percentage_2 = ClusterOutput(sustainable_facade_percentage)

# ==== cluster SunLightHrs
pt = ClusterInput()
mesh = ClusterInput()
domain = ClusterInput()
crv = ClusterInput()
mesh_2 = Mesh(mesh)
domain_2 = Domain(domain)
crv_2 = Curve(crv)
pt_2 = Point(pt)
dedomain = DeconstructDomain(Domain=domain_2)  # -> Start, End
subtraction = Subtraction(A=dedomain.End, B=dedomain.Start)
xy = XYPlane(Origin=Point(0, 0, 0))
divide = DivideCurve(Curve=crv_2, Count=subtraction, Kinks=False)  # -> Points, Tangents, Parameters
ln = Line(StartPoint=divide.Points, EndPoint=xy)
crv_3 = Curve(ln)
crv_4 = Curve(crv_3)
occ = Occlusion(Samples=pt_2, Obstructions=mesh_2, Rays=crv_4)  # -> Hits, Occlusion
lng = ListLength(List=crv_4)
subtraction_2 = Subtraction(A=lng, B=occ.Hits)
match = MatchTree(Tree=subtraction_2, Guide=pt_2)
direct_sun_light_hours_day_each_sample_i = Number(match)  # "Direct Sun Light Hours / Day Each Sample in that Month"
direct_sun_light_hours_day_each_sample_i_2 = ClusterOutput(direct_sun_light_hours_day_each_sample_i)  # "Direct Sun Light Hours / Day Each Sample in that Month"
