# Grasshopper definition Sufficient Daylight Hour Tool.gh (Grasshopper 1.0.7)

int_tower_type = Integer(Slider(0, range=0..4))
geo_lots = Geometry(flatten(<curve referenced from the Rhino model>))
pt_north = Point(<point referenced from the Rhino model>)
int_far = Integer(Slider(4, range=0..10))
towers = Towers(geo_lots=geo_lots, int_tower_type=int_tower_type, int_far=int_far, pt_north=pt_north)  # -> geo_tower_2, num_total_floor_area_2
geo_tower = Geometry(towers.geo_tower_2)
geo_tower_2 = Geometry(geo_tower)

# ---- group: CREATING GARDEN FOR TOWER TYPOLOGY
geo_tower_3 = Geometry(towers.geo_tower_2)
cluster = Cluster_5(brep=geo_tower_3)  # -> srf_garden_2, geo_wall_2
geo_garden = Geometry(cluster.srf_garden_2)
srf_tower_garden = Surface(geo_garden)
geo_wall = Geometry(cluster.geo_wall_2)
crv = Curve(srf_tower_garden)
edges = BrepEdges(Brep=geo_wall)  # -> Naked, Interior, NonManifold
preview = CustomPreview(Geometry=geo_garden, Material=ColourSwatch(SwatchColor=RGB(162, 224, 99)))
preview_2 = CustomPreview(Geometry=geo_wall, Material=ColourSwatch(SwatchColor=RGB(255, 255, 255)))
preview_3 = CustomPreview(Geometry=edges.Naked, Material=ColourSwatch(SwatchColor=RGB(0, 0, 0)))

# ----
edges_2 = BrepEdges(Brep=geo_tower_2)  # -> Naked, Interior, NonManifold
preview_4 = CustomPreview(Geometry=geo_tower_2, Material=ColourSwatch(SwatchColor=RGB(255, 255, 255)))
preview_5 = CustomPreview(
    Geometry=edges_2.Interior,
    Material={diffuse=RGB(221, 160, 221), emission=RGB(66, 48, 66), shine=0.5, specular=RGB(255, 255, 255), transparency=0})
crv_tower_garden = Curve(graft(crv))
sunion = SolidUnion(Breps=geo_tower_2)
geo_buildings_to_test = Geometry(graft(sunion))
crv_gardens = Curve(flatten(crv_tower_garden))
crv_gardens_2 = Curve(crv_gardens)

# ---- group: SUNLIGHT ANALYSIS METRIC
distance_off_of_ground_in_document_units = Panel("2")
geo_context_obstructions_without = Geometry([<brep referenced from the Rhino model> x20])
geo_building_s_to_test = Geometry(geo_buildings_to_test)
analysis_resolution = Panel("7")
epw_file_url = Panel("https://www.energyplus.net/weather-download/north_and_central_america_wmo_region_4/USA/NY/USA_NY_New.York.City-Central.Park.94728_TMY/all")
crv_analysis_area = Curve(crv_gardens_2)
start_time = Panel("7")
end_time = Panel("18")
day = Panel("15")
path_epw_file_location = FilePath("D:\Teaching\A&U\Average Daylight Hours\Weather Data\CAN_ON_Toronto.City.715080_CWEC2016.epw")
min_hour_threshold = Panel("3")
month = Panel("""4
5""")
cluster_2 = Cluster(geo_context_obstructions=geo_context_obstructions_without)
merge = Merge(Data1=flatten(geo_building_s_to_test), Data2=flatten(cluster_2))
cluster_3 = Cluster(geo_context_obstructions=merge)
cluster_4 = Cluster_2(crv_analysis_area=crv_analysis_area, num_analysis_resolution=analysis_resolution)
num_distance_off_of_ground = Number(distance_off_of_ground_in_document_units)
Z = UnitZ(Factor=num_distance_off_of_ground)
move = Move(Geometry=cluster_4, Motion=Z)  # -> Geometry, Transform
cluster_5 = Cluster_3(
    mesh_obstructions=cluster_3,
    num_distance_off_of_ground=num_distance_off_of_ground,
    srf_analysis_surfaces=cluster_4,
    num_start_time=start_time,
    num_end_time=end_time,
    int_days=day,
    int_months=month,
    path_epw_file_url=epw_file_url)  # -> num_is_sun_visible_3, num_number_of_hours_per_day_2
num_min_hour_threshold = Number(min_hour_threshold)
mesh = Mesh(move.Geometry)
cluster_6 = Cluster_4(
    num_is_sun_visible=cluster_5.num_is_sun_visible_3,
    num_number_of_hours_per_day=cluster_5.num_number_of_hours_per_day_2,
    num_hour_threshold=num_min_hour_threshold)  # -> num_in_sun_avg_2, num_average_hours_2, num_average_hours_per_analysis_point_2, num_passing_threshold_4, num_passing_threshold_3
mesh_2 = Mesh(graft(mesh))
num_min_hour_threshold_2 = Number(min_hour_threshold)
panel = Panel("0")
gradient = Gradient(
    LowerLimit=num_min_hour_threshold_2,
    UpperLimit="10",
    Parameter=cluster_6.num_average_hours_per_analysis_point_2,
    stops=[0: RGB(0, 0, 0), 0.231: RGB(173, 203, 249), 0.5: RGB(254, 244, 84), 0.75: RGB(234, 126, 0), 1: RGB(234, 38, 0)])
gradient_2 = Gradient(
    LowerLimit="0",
    UpperLimit="1",
    Parameter=cluster_6.num_passing_threshold_4,
    stops=[0: RGB(255, 74, 74), 1: RGB(105, 255, 252)])
mcol = MeshColours(Mesh=mesh_2, Colours=gradient)
mcol_2 = MeshColours(Mesh=mesh_2, Colours=gradient_2)

# ----
average_hours = Panel(cluster_6.num_average_hours_2)
average_for_analysis_area = Panel(cluster_6.num_in_sun_avg_2)
passing_threshold = Panel(cluster_6.num_passing_threshold_3)
num_avg_hr_per_pt = Number(flatten(cluster_6.num_average_hours_per_analysis_point_2))
num_avg_hr_per_pt_2 = Number(flatten(cluster_6.num_average_hours_per_analysis_point_2))
srf_analysis_srf = Surface(flatten(move.Geometry))
num_avg_hr_per_pt_3 = Number(flatten(cluster_6.num_average_hours_per_analysis_point_2))
larger = LargerThan(FirstNumber=num_avg_hr_per_pt, SecondNumber="10")  # -> LargerThan, OrEqualTo
larger_2 = LargerThan(FirstNumber=num_avg_hr_per_pt_2, SecondNumber="7")  # -> LargerThan, OrEqualTo
larger_3 = LargerThan(FirstNumber=num_avg_hr_per_pt_3, SecondNumber="3")  # -> LargerThan, OrEqualTo
dispatch = Dispatch(List=srf_analysis_srf, DispatchPattern=larger.LargerThan)  # -> ListA, ListB
dispatch_2 = Dispatch(List=dispatch.ListB, DispatchPattern=larger_2.LargerThan)  # -> ListA, ListB
dispatch_3 = Dispatch(List=dispatch_2.ListB, DispatchPattern=larger_3.LargerThan)  # -> ListA, ListB
srf_tomatoes = Surface(dispatch_2.ListA)
srf_spinach = Surface(dispatch_3.ListA)
srf_carrots = Surface(dispatch.ListA)
srf = Surface(dispatch_3.ListB)
mesh_3 = Mesh(srf_spinach)
mesh_4 = Mesh(srf_tomatoes)
mesh_5 = Mesh(srf_carrots)
mesh_6 = Mesh(srf)
mcol_3 = MeshColours(Mesh=mesh_5, Colours=ColourSwatch(SwatchColor=RGB(255, 132, 0)))
mcol_4 = MeshColours(Mesh=mesh_4, Colours=ColourSwatch(SwatchColor=RGB(255, 0, 0)))
mcol_5 = MeshColours(Mesh=mesh_3, Colours=ColourSwatch(SwatchColor=RGB(0, 166, 47)))
mcol_6 = MeshColours(Mesh=mesh_6, Colours=ColourSwatch(SwatchColor=RGB(0, 0, 0)))

# ==== cluster Cluster
geo_context_obstructions = ClusterInput()
geo_context_obstructions_2 = Geometry(geo_context_obstructions)
mesh = Mesh(geo_context_obstructions_2)
mjoin = MeshJoin(Meshes=mesh)
mesh_obstructions = Mesh(mjoin)
mesh_obstructions_2 = ClusterOutput(mesh_obstructions)

# ==== cluster Cluster_2
num_analysis_resolution = ClusterInput()
crv_analysis_area = ClusterInput()
num_analysis_resolution_2 = Number(num_analysis_resolution)
crv_analysis_area_2 = Curve(crv_analysis_area)

# ---- group: Surfaces to analyze
srf = Surface(graft(crv_analysis_area_2))

# ----
dim = Dimensions(Surface=srf)  # -> UDimension, VDimension
division = Division(A=dim.UDimension, B=num_analysis_resolution_2)
division_2 = Division(A=dim.VDimension, B=num_analysis_resolution_2)
divide = DivideDomain²(Domain=srf, UCount=division, VCount=division_2)
subsrf = Isotrim(Surface=srf, Domain=divide)  # -> flatten(Surface)
srf_analysis_surfaces = Surface(subsrf)
srf_analysis_surfaces_2 = ClusterOutput(srf_analysis_surfaces)

# ==== cluster Cluster_3
num_start_time = ClusterInput()
num_end_time = ClusterInput()
int_months = ClusterInput()
int_days = ClusterInput()
num_start_time_2 = Number(num_start_time)
num_end_time_2 = Number(num_end_time)
int_months_2 = Integer(graft(int_months))
int_days_2 = Integer(int_days)
path_epw_file_url = ClusterInput()
srf_analysis_surfaces = ClusterInput()
num_distance_off_of_ground = ClusterInput()
path_epw_file_url_2 = FilePath(path_epw_file_url)
mesh_obstructions = ClusterInput()
num_end_time_3 = Number(num_end_time_2)
int_days_3 = Integer(int_days_2)
int_months_3 = Integer(int_months_2)
srf_analysis_surfaces_2 = Surface(srf_analysis_surfaces)
num_distance_off_of_ground_2 = Number(num_distance_off_of_ground)
mesh_obstructions_2 = Mesh(mesh_obstructions)
epw_stat = Ladybug_OpenEPWAndSTATWeatherFiles(weatherFileURL=path_epw_file_url_2)  # -> epwFile, statFile; plug-in component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
evalsrf = EvaluateSurface(Surface=reparameterize(srf_analysis_surfaces_2), Point="{0.5,0.5,0}")  # -> Point, Normal, UDirection, VDirection, Frame
lng = ListLength(List=int_months_3)
lng_2 = ListLength(List=int_days_3)

# ---- group: Weather File
importlocation = Ladybug_ImportLocation(epwFile=epw_stat.epwFile)  # -> location; plug-in component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

# ----
ladybug = Ladybug_Ladybug()  # -> out; plug-in component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
pt = Point(evalsrf.Point)
Z = UnitZ(Factor=num_distance_off_of_ground_2)
move = Move(Geometry=pt, Motion=Z)  # -> Geometry, Transform

# ---- group: Hours
num_start_time_3 = Number(num_start_time_2)

# ----
subtraction = Subtraction(A=num_end_time_3, B=num_start_time_3)

# ---- group: Hours (continued)
series = Series(Start=num_start_time_3, Step=1, Count=expr("X+1", subtraction))

# ----
int = Integer(series)
sunpath = Ladybug_SunPath(location=importlocation, hour=int, day=int_days_3, month=int_months_3, timeStep=1, dailyOrAnnualSunPath=True)  # -> out, sunVectors, sunAltitudes, sunAzimuths, port, sunSpheresMesh, sunPathCrvs, compassCrvs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; plug-in component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
lng_3 = ListLength(List=sunpath.sunVectors)
panel = Panel(sunpath.sunPositionsInfo)
occ = Occlusion(Samples=graft(move.Geometry), Obstructions=mesh_obstructions_2, Rays=flatten(sunpath.sunVectors))  # -> Hits, Occlusion
not = GateNot(A=occ.Occlusion)
num_is_sun_visible = Number(not)
num_number_of_hours_per_day = Number(flatten(lng_3))
num_is_sun_visible_2 = Number(simplify(num_is_sun_visible))
num_is_sun_visible_3 = ClusterOutput(num_is_sun_visible_2)
num_number_of_hours_per_day_2 = ClusterOutput(num_number_of_hours_per_day)

# ==== cluster Cluster_4
num_number_of_hours_per_day = ClusterInput()
num_hour_threshold = ClusterInput()
num_is_sun_visible = ClusterInput()
num_number_of_hours_per_day_2 = Number(num_number_of_hours_per_day)
num_hour_threshold_2 = Number(num_hour_threshold)
num_is_sun_visible_2 = Number(num_is_sun_visible)
ma = MassAddition(Input=num_number_of_hours_per_day_2)  # -> Result, PartialResults
shift = ShiftList(List=ma.PartialResults, Shift="-1", Wrap=False)
addition = Addition(A=shift, B="1")
merge = Merge(Data1="0", Data2=flatten(addition))
dom = ConstructDomain(DomainStart=merge, DomainEnd=ma.PartialResults)
subset = SubList(List=num_is_sun_visible_2, Domain=dom, Wrap=True)  # -> List, Index
ma_2 = MassAddition(Input=num_is_sun_visible_2)  # -> Result, PartialResults
lng = ListLength(List=num_is_sun_visible_2)
ma_3 = MassAddition(Input=subset.List)  # -> Result, PartialResults
path_mapper = PathMapper(ma_3.Result, source="{A;B}", target="{A}")
division = Division(A=ma_2.Result, B=lng)
avr = Average(Input=flatten(division))
avr_2 = Average(Input=path_mapper)
avr_3 = Average(Input=flatten(avr_2))
larger = LargerThan(FirstNumber=avr_2, SecondNumber=num_hour_threshold_2)  # -> LargerThan, OrEqualTo
avr_4 = Average(Input=flatten(larger.LargerThan))
num_average_hours_per_analysis_point = Number(avr_2)
num_in_sun_avg = Number(avr)
num_average_hours = Number(avr_3)
num_passing_threshold = Number(larger.LargerThan)
num_passing_threshold_2 = Number(avr_4)
num_in_sun_avg_2 = ClusterOutput(num_in_sun_avg)
num_average_hours_2 = ClusterOutput(num_average_hours)
num_average_hours_per_analysis_point_2 = ClusterOutput(num_average_hours_per_analysis_point)
num_passing_threshold_3 = ClusterOutput(num_passing_threshold_2)
num_passing_threshold_4 = ClusterOutput(num_passing_threshold)

# ==== cluster Towers
pt_north = ClusterInput()
geo_lots = ClusterInput()
int_far = ClusterInput()
int_tower_type = ClusterInput()
pt_north_2 = Point(pt_north)
geo_lots_2 = Geometry(geo_lots)
int_far_2 = Integer(int_far)
int_tower_type_2 = Integer(int_tower_type)
lng = ListLength(List=geo_lots_2)
random = Random(Range=Domain(-1.5, 1.5), Number=lng, Seed=2)
addition = Addition(A=random, B=int_far_2)
gate = StreamGate(Stream=geo_lots_2, Gate=int_tower_type_2)  # -> Target0, Target1, Target2, Target3
parcel = Curve(gate.Target0)
far = Panel(addition)
parcel_2 = Curve(gate.Target1)
parcel_3 = Curve(gate.Target3)
parcel_4 = Curve(gate.Target2)
far_2 = Panel(addition)
far_3 = Panel(addition)
far_4 = Panel(addition)
tower_stacked = TowerStacked(crv=parcel_2, num=far_3, north=pt_north_2)
tower_stepped = TowerStepped(crv=parcel, num=far, north=pt_north_2)
tower_offset = TowerOffset(crv=parcel_4, num=far_4)
tower_balcony = TowerBalcony(crv=parcel_3, num=far_2)
geo = Geometry(tower_stepped)
geo_2 = Geometry(tower_stacked)
geo_3 = Geometry(tower_offset)
geo_4 = Geometry(tower_balcony)
merge = Merge(Data1=geo, Data2=geo_2, Data3=geo_3, Data4=geo_4)
geo_lots_3 = Geometry(geo_lots_2)
num = Number(addition)
area = Area(Geometry=geo_lots_3)  # -> Area, Centroid
multiplication = Multiplication(A=num, B=area.Area)
geo_tower = Geometry(merge)
num_total_floor_area = Number(multiplication)
geo_tower_2 = ClusterOutput(geo_tower)
num_total_floor_area_2 = ClusterOutput(num_total_floor_area)

# ==== cluster Cluster_5
brep = ClusterInput()
brep_2 = Brep(brep)
debrep = DeconstructBrep(Brep=brep_2)  # -> Faces, Edges, Vertices
evalsrf = EvaluateSurface(Surface=reparameterize(debrep.Faces), Point="{0.5,0.5,0}")  # -> Point, Normal, UDirection, VDirection, Frame
devec = DeconstructVector(Vector=evalsrf.Normal)  # -> XComponent, YComponent, ZComponent
abs = Absolute(Value=devec.ZComponent)
smaller = SmallerThan(FirstNumber=devec.ZComponent, SecondNumber="1")  # -> SmallerThan, OrEqualTo
dispatch = Dispatch(List=debrep.Faces, DispatchPattern=smaller.SmallerThan)  # -> ListA, ListB
outpt_cap = Surface(dispatch.ListB)
srf_garden = Surface(outpt_cap)
geo_wall = Geometry(dispatch.ListA)
srf_garden_2 = ClusterOutput(srf_garden)
geo_wall_2 = ClusterOutput(geo_wall)

# ==== cluster TowerBalcony
crv = ClusterInput()
base_scale = Slider(0.9, range=0..1)
num = ClusterInput()
crv_2 = Curve(crv)
num_2 = Number(num)
area = Area(Geometry=crv_2)  # -> Area, Centroid
pcen = PolygonCenter(Polyline=crv_2)  # -> CenterV, CenterE, CenterA
floor = Slider(11, range=0..100)
number_slider = Slider(2, range=0..10)
scale = Scale(Geometry=crv_2, Center=pcen.CenterV, Factor=base_scale)  # -> Geometry, Transform
multiplication = Multiplication(A=num_2, B=area.Area)
multiplication_2 = Multiplication(A=floor, B=number_slider)
boundary = BoundarySurfaces(Edges=scale.Geometry)
area_2 = Area(Geometry=boundary)  # -> Area, Centroid
Z = UnitZ(Factor=multiplication_2)
geo = Geometry(scale.Geometry)
multiplication_3 = Multiplication(A=area_2.Area, B=number_slider)
extr = Extrude(Base=boundary, Direction=Z)
subtraction = Subtraction(A=multiplication, B=multiplication_3)
move = Move(Geometry=boundary, Motion=Z)  # -> Geometry, Transform
number_slider_2 = Slider(0.5, range=0..1)
pcen_2 = PolygonCenter(Polyline=move.Geometry)  # -> CenterV, CenterE, CenterA
move_2 = Move(Geometry=geo, Motion=Z)  # -> Geometry, Transform
scale_2 = Scale(Geometry=move.Geometry, Center=pcen_2.CenterV, Factor=number_slider_2)  # -> Geometry, Transform
area_3 = Area(Geometry=scale_2.Geometry)  # -> Area, Centroid
division = Division(A=subtraction, B=area_3.Area)
geo_2 = Geometry(scale_2.Geometry)
int = Integer(division)
multiplication_4 = Multiplication(A=floor, B=int)
pcen_3 = PolygonCenter(Polyline=move_2.Geometry)  # -> CenterV, CenterE, CenterA
Z_2 = UnitZ(Factor=multiplication_4)
extr_2 = Extrude(Base=scale_2.Geometry, Direction=Z_2)
scale_3 = Scale(Geometry=move_2.Geometry, Center=pcen_3.CenterV, Factor=Slider(0.62, range=0..1))  # -> Geometry, Transform
geo_3 = Geometry(extr)
scale_4 = Scale(Geometry=move_2.Geometry, Center=pcen_2.CenterV, Factor=number_slider_2)  # -> Geometry, Transform
series = Series(Start=floor, Step=floor, Count=expr("x-1", int))
graft = GraftTree(Tree=scale_4.Geometry, IncludeEmptyLists=True, IncludeNullItems=True)
graft_2 = GraftTree(Tree=scale_3.Geometry, IncludeEmptyLists=True, IncludeNullItems=True)
Z_3 = UnitZ(Factor=series)
merge = Merge(Data1=graft, Data2=graft_2)
loft = Loft(Curves=merge, Options={Adjust=False, Closed=False, LoftEnds=0, LoftSimp=0, LoftType=0, Rebuild=10, Refit=0.01})
move_3 = Move(Geometry=loft, Motion=Z_3)  # -> Geometry, Transform
Z_4 = UnitZ(Factor=Slider(4, range=0..10))
extr_3 = Extrude(Base=move_3.Geometry, Direction=Z_4)
merge_2 = Merge(Data1=extr_2, Data2=geo_3, Data3=extr_3)  # -> flatten(Result)
sunion = SolidUnion(Breps=merge_2)  # -> flatten(Result)
R = ClusterOutput(sunion)

# ==== cluster TowerOffset
crv = ClusterInput()
base_scale = Slider(0.9, range=0..1)
num = ClusterInput()
crv_2 = Curve(crv)
num_2 = Number(num)
area = Area(Geometry=crv_2)  # -> Area, Centroid
pcen = PolygonCenter(Polyline=crv_2)  # -> CenterV, CenterE, CenterA
floor = Slider(11, range=0..100)
number_slider = Slider(2, range=0..10)
scale = Scale(Geometry=crv_2, Center=pcen.CenterV, Factor=base_scale)  # -> Geometry, Transform
multiplication = Multiplication(A=num_2, B=area.Area)
multiplication_2 = Multiplication(A=floor, B=number_slider)
boundary = BoundarySurfaces(Edges=scale.Geometry)
area_2 = Area(Geometry=boundary)  # -> Area, Centroid
Z = UnitZ(Factor=multiplication_2)
multiplication_3 = Multiplication(A=area_2.Area, B=number_slider)
extr = Extrude(Base=boundary, Direction=Z)
move = Move(Geometry=boundary, Motion=Z)  # -> Geometry, Transform
subtraction = Subtraction(A=multiplication, B=multiplication_3)
pcen_2 = PolygonCenter(Polyline=move.Geometry)  # -> CenterV, CenterE, CenterA
scale_2 = Scale(Geometry=move.Geometry, Center=pcen_2.CenterV, Factor=Slider(0.5, range=0..1))  # -> Geometry, Transform
area_3 = Area(Geometry=scale_2.Geometry)  # -> Area, Centroid
division = Division(A=subtraction, B=area_3.Area)
int = Integer(division)
multiplication_4 = Multiplication(A=floor, B=int)
Z_2 = UnitZ(Factor=multiplication_4)
extr_2 = Extrude(Base=scale_2.Geometry, Direction=Z_2)
geo = Geometry(extr)
move_2 = Move(Geometry=extr_2, Motion="{0,0,-0.1}")  # -> Geometry, Transform
merge = Merge(Data1=move_2.Geometry, Data2=geo)
sunion = SolidUnion(Breps=flatten(merge))
R = ClusterOutput(sunion)

# ==== cluster TowerStacked
crv = ClusterInput()
north = ClusterInput()
number_slider = Slider(0.4, range=0..1)
number_slider_2 = Slider(0.6, range=0..1)
crv_2 = Curve(crv)
num = ClusterInput()
north_2 = Point(north)
num_2 = Number(num)
pln = Plane(crv_2)
floor = Slider(11, range=0..100)
scale_nu = ScaleNU(Geometry=crv_2, Plane=pln, ScaleX=number_slider_2, ScaleY=number_slider, ScaleZ=1)  # -> Geometry, Transform
scale_nu_2 = ScaleNU(Geometry=crv_2, Plane=pln, ScaleX=number_slider, ScaleY=number_slider_2, ScaleZ=1)  # -> Geometry, Transform
pcen = PolygonCenter(Polyline=crv_2)  # -> CenterV, CenterE, CenterA
pcen_2 = PolygonCenter(Polyline=scale_nu_2.Geometry)  # -> CenterV, CenterE, CenterA
pcen_3 = PolygonCenter(Polyline=scale_nu.Geometry)  # -> CenterV, CenterE, CenterA
boundary = BoundarySurfaces(Edges=crv_2)
vec2pt = Vector2Pt(PointA=pcen_3.CenterV, PointB=pcen.CenterV, Unitize=False)  # -> Vector, Length
area = Area(Geometry=boundary)  # -> Area, Centroid
vec2pt_2 = Vector2Pt(PointA=pcen_2.CenterV, PointB=pcen.CenterV, Unitize=False)  # -> Vector, Length
move = Move(Geometry=scale_nu.Geometry, Motion=vec2pt.Vector)  # -> Geometry, Transform
move_2 = Move(Geometry=scale_nu_2.Geometry, Motion=vec2pt_2.Vector)  # -> Geometry, Transform
explode = Explode(Curve=move.Geometry, Recursive=True)  # -> Segments, simplify(Vertices)
explode_2 = Explode(Curve=move_2.Geometry, Recursive=True)  # -> Segments, Vertices
boundary_2 = BoundarySurfaces(Edges=move_2.Geometry)
area_2 = Area(Geometry=boundary_2)  # -> Area, Centroid
division = Division(A=area_2.Area, B=area.Area)
division_2 = Division(A=num_2, B=division)
multiplication = Multiplication(A=division_2, B=floor)
pull = PullPoint(Point=north_2, Geometry=explode.Vertices, ClosestOnly=True)  # -> ClosestPoint, Distance
pull_2 = PullPoint(Point=north_2, Geometry=explode_2.Vertices, ClosestOnly=True)  # -> ClosestPoint, Distance
division_3 = Division(A=multiplication, B=Slider(5, range=0..10))
Z = UnitZ(Factor=division_3)
vec2pt_3 = Vector2Pt(PointA=flatten(pull.ClosestPoint), PointB=flatten(pull_2.ClosestPoint), Unitize=False)  # -> Vector, Length
number_slider_3 = Slider(2, range=0..10)
move_3 = Move(Geometry=move.Geometry, Motion=vec2pt_3.Vector)  # -> Geometry, Transform
merge = Merge(Data1=number_slider_3, Data2=Slider(4, range=0..10))
move_4 = Move(Geometry=move_3.Geometry, Motion=Z)  # -> Geometry, Transform
multiplication_2 = Multiplication(A=Z, B=graft(merge))
multiplication_3 = Multiplication(A=Z, B=number_slider_3)
boundary_3 = BoundarySurfaces(Edges=move_4.Geometry)
extr = Extrude(Base=boundary_2, Direction=Z)
extr_2 = Extrude(Base=boundary_3, Direction=Z)
move_5 = Move(Geometry=extr_2, Motion=multiplication_3)  # -> Geometry, Transform
move_6 = Move(Geometry=extr, Motion=multiplication_2)  # -> Geometry, Transform
merge_2 = Merge(Data1=extr_2, Data2=extr, Data3=move_5.Geometry, Data4=move_6.Geometry)
flatten = FlattenTree(Tree=merge_2, Path="{0}")
sunion = SolidUnion(Breps=flatten)
R = ClusterOutput(sunion)

# ==== cluster TowerStepped
upper_scale = Slider(0.6, range=0..1)
north = ClusterInput()
base_scale = Slider(0.7, range=0..1)
crv = ClusterInput()
crv_2 = Curve(crv)
north_2 = Point(north)
pcen = PolygonCenter(Polyline=crv_2)  # -> CenterV, CenterE, CenterA
num = ClusterInput()
sqr = Square(Value=upper_scale)
sqr_2 = Square(Value=base_scale)
scale = Scale(Geometry=crv_2, Center=pcen.CenterV, Factor=base_scale)  # -> Geometry, Transform
num_2 = Number(num)
floor = Slider(11, range=0..100)
multiplication = Multiplication(A=sqr_2, B=sqr)
boundary = BoundarySurfaces(Edges=scale.Geometry)
division = Division(A=num_2, B=multiplication)
int = Integer(division)
multiplication_2 = Multiplication(A=int, B=floor)
division_2 = Division(A=int, B=3)
division_3 = Division(A=multiplication_2, B=3)
Z = UnitZ(Factor=division_3)
move = Move(Geometry=scale.Geometry, Motion=Z)  # -> Geometry, Transform
explode = Explode(Curve=move.Geometry, Recursive=True)  # -> Segments, simplify(Vertices)
extr = Extrude(Base=boundary, Direction=Z)
Z_2 = UnitZ(Factor=floor)
series = Series(Start=1, Step=1, Count=division_2)  # -> simplify(Series)
pull = PullPoint(Point=north_2, Geometry=explode.Vertices, ClosestOnly=True)  # -> ClosestPoint, Distance
scale_2 = Scale(Geometry=move.Geometry, Center=flatten(pull.ClosestPoint), Factor=upper_scale)  # -> Geometry, Transform
multiplication_3 = Multiplication(A=Z_2, B=series)
Z_3 = UnitZ(Factor=division_3)
boundary_2 = BoundarySurfaces(Edges=scale_2.Geometry)
srf = Surface(boundary)
move_2 = Move(Geometry=scale_2.Geometry, Motion=Z_3)  # -> Geometry, Transform
extr_2 = Extrude(Base=boundary_2, Direction=Z_3)
area = Area(Geometry=srf)  # -> Area, Centroid
explode_2 = Explode(Curve=move_2.Geometry, Recursive=True)  # -> Segments, Vertices
pull_2 = PullPoint(Point=pull.ClosestPoint, Geometry=explode_2.Vertices, ClosestOnly=True)  # -> ClosestPoint, Distance
scale_3 = Scale(Geometry=move_2.Geometry, Center=flatten(pull_2.ClosestPoint), Factor=upper_scale)  # -> Geometry, Transform
boundary_3 = BoundarySurfaces(Edges=scale_3.Geometry)
Z_4 = UnitZ(Factor=division_3)
crv_3 = Curve(crv_2)
extr_3 = Extrude(Base=boundary_3, Direction=Z_4)
area_2 = Area(Geometry=crv_3)  # -> Area, Centroid
brep = Brep(extr_2)
brep_2 = Brep(extr_3)
brep_3 = Brep(extr)
merge = Merge(Data1=brep_2, Data2=brep, Data3=brep_3)  # -> flatten(Result)
sunion = SolidUnion(Breps=merge)
R = ClusterOutput(sunion)
