# Grasshopper definition Walking Distance to Park.gh (Grasshopper 1.0.7)

# ----
# XIM Standards
# Inputs
data = Data(True)

brep_buildings = Brep([<brep referenced from the Rhino model> x139])
srf_new_parks = Surface([<surface referenced from the Rhino model> x14])
srf_existing_parks = Surface([<surface referenced from the Rhino model> x32])
min_walking_threshold = Panel("10")
ft_min = Panel("225")

# ----
# Ouputs
data_2 = Data(True)

debrep = DeconstructBrep(Brep=brep_buildings)  # -> Faces, Edges, Vertices
merge = Merge(Data1=srf_new_parks, Data2=srf_existing_parks)

# ----
# Note
# Previews
note_panel = Panel("")

# ----
# Actions
walkability_distance_to_parks = WalkabilityDistanceToParks(mesh=brep_buildings, d1=srf_new_parks, d2=srf_existing_parks)  # -> flatten(i)
int_min_walking_threshold = Integer(min_walking_threshold)
# DO NOT CHANGE
avr = Average(Input=flatten(walkability_distance_to_parks))
multiplication = Multiplication(A=int_min_walking_threshold, B=ft_min)
int_distance_to_park = Integer(walkability_distance_to_parks)
int_avg_distance = Integer(avr)
int_distance_threshold = Integer(multiplication)
brep_building = Brep(brep_buildings)
crv_building_edges = Curve(debrep.Edges)
srf_all_parks = Surface(merge)
panel = Panel(int_avg_distance)
gradient = Gradient(
    LowerLimit="0",
    UpperLimit=int_distance_threshold,
    Parameter=int_distance_to_park,
    stops=[0: RGB(234, 38, 0), 0.25: RGB(234, 126, 0), 0.5: RGB(254, 244, 84), 0.75: RGB(173, 203, 249), 1: RGB(75, 107, 169)])

preview = CustomPreview(Geometry=brep_building, Material=gradient)
preview_2 = CustomPreview(Geometry=crv_building_edges, Material=ColourSwatch(SwatchColor=RGB(0, 0, 0)))
preview_3 = CustomPreview(Geometry=srf_all_parks, Material=ColourSwatch(SwatchColor=RGB(116, 227, 121)))

# ==== cluster WalkabilityDistanceToParks
mesh = ClusterInput()
mesh_2 = Mesh(mesh)
d1 = ClusterInput()
d2 = ClusterInput()
mshadow = MeshShadow(Mesh=mesh_2, Light=Vector(0, 0, -1), Plane=PlaneXY(0, 0, 0))
merge = Merge(Data1=d1, Data2=d2)
len = Length(Curve=mshadow)
debrep = DeconstructBrep(Brep=merge)  # -> Faces, Edges, Vertices
division = Division(A=len, B="50")
crv_parks = Curve(debrep.Edges)
divdist = DivideDistance(Curve=mshadow, Distance=division)  # -> Points, Tangents, Parameters
pull = PullPoint(Point=divdist.Points, Geometry=crv_parks, ClosestOnly=True)  # -> ClosestPoint, Distance
sort = SortList(Keys=pull.Distance)  # -> Keys, ValuesA
item = ListItem(List=sort.Keys, Index=0, Wrap=True)
i = ClusterOutput(item)
