# Grasshopper definition Podium_Tower_Bridge.gh (Grasshopper 1.0.7)

# ----
# XIM Standards
# Inputs
data = Data(True)

# ----
# Ouputs
data_2 = Data(True)

multiplication = Multiplication(A=Slider(3, range=3..5), B="10")
brep_podium = Brep([<brep referenced from the Rhino model> x29])
base_crv = Curve([<curve referenced from the Rhino model> x29])
construct_domain = ConstructDomain(DomainStart=Slider(25, range=0..40), DomainEnd=Slider(60, range=0..60))
int_height_variation = Integer(Slider(0, range=0..2))
int_brige_variarion = Integer(Slider(0, range=0..2))
num_floor_to_have_bridge = Number(multiplication)
num_bridge_width = Number("40")

# ----
# Note
# Previews
note_panel = Panel("")

crv_bridging = Curve(base_crv)
cluster = Cluster(
    base=crv_bridging,
    range=construct_domain,
    list=crv_bridging,
    seed=int_height_variation,
    num_floor_to_have_bridge=num_floor_to_have_bridge,
    int_brige_variarion=int_brige_variarion,
    num_bridge_width=num_bridge_width)  # -> geo_cap_bridge_2, geo_bridge_building_2, R, geo_18, geo_12, geo_7
geo_bridge_building = Geometry(cluster.geo_bridge_building_2)
srf_bridge = Surface(cluster.R)
merge = Merge(Data1=brep_podium, Data2=geo_bridge_building)
debrep = DeconstructBrep(Brep=merge)  # -> Faces, Edges, Vertices
edges = BrepEdges(Brep=merge)  # -> Naked, Interior, NonManifold

preview = CustomPreview(Geometry=debrep.Faces, Material=ColourSwatch(SwatchColor=RGB(255, 255, 255)))
preview_2 = CustomPreview(Geometry=srf_bridge, Material=ColourSwatch(SwatchColor=RGB(116, 227, 121)))

preview_3 = CustomPreview(Geometry=edges.Interior, Material=ColourSwatch(SwatchColor=RGB(0, 0, 0)))

# ==== cluster Cluster
list = ClusterInput()
list_length = ListLength(List=list)
range = ClusterInput()
seed = ClusterInput()
random = Random(Range=range, Number=list_length, Seed=seed)
multiplication = Multiplication(A=random, B=Slider(10, range=0..10))
unit_z = UnitZ(Factor=multiplication)
base = ClusterInput()
extrude = Extrude(Base=base, Direction=unit_z)
move = Move(Geometry=base, Motion=unit_z)  # -> Geometry, Transform
num_floor_to_have_bridge = ClusterInput()
boundary = BoundarySurfaces(Edges=move.Geometry)
cap_holes = CapHoles(Brep=graft(extrude))
geo_cap_bridge = Geometry(boundary)
num_floor_to_have_bridge_2 = Number(num_floor_to_have_bridge)
geo_cap_bridge_2 = ClusterOutput(geo_cap_bridge)
geo_bridge_building = Geometry(cap_holes)
multiplication_2 = Multiplication(A=num_floor_to_have_bridge_2, B=Slider(5, range=0..10))
geo_bridge_building_2 = ClusterOutput(geo_bridge_building)
Z = UnitZ(Factor=1)
contour = Contour(Shape=geo_bridge_building, Point=Point(0, 0, 0), Direction=Z, Distance=multiplication_2)
crv = Curve(flatten(contour))
curvepoint = PointOnCurve(crv, parameter=0.5)
pt = Point(curvepoint)
pdecon = Deconstruct(Point=pt)  # -> XComponent, YComponent, ZComponent
area = Area(Geometry=contour)  # -> Area, Centroid
int_brige_variarion = ClusterInput()
crv_2 = Curve(flatten(crv))
crv_3 = Curve(flatten(crv))
lng = ListLength(List=area.Centroid)
int_brige_variarion_2 = Integer(int_brige_variarion)
multiplication_3 = Multiplication(A=lng, B="0.7")
ln = Line(StartPoint=area.Centroid, EndPoint=flatten(area.Centroid))
equals = Equality(FirstNumber=pdecon.ZComponent, SecondNumber="600")  # -> Equality, Inequality
equals_2 = Equality(FirstNumber=pdecon.ZComponent, SecondNumber="450")  # -> Equality, Inequality
equals_3 = Equality(FirstNumber=pdecon.ZComponent, SecondNumber="150")  # -> Equality, Inequality
reduce = RandomReduce(List=ln, Reduction=multiplication_3, Seed=int_brige_variarion_2)
dispatch = Dispatch(List=crv_3, DispatchPattern=equals_3.Equality)  # -> ListA, ListB
dispatch_2 = Dispatch(List=crv, DispatchPattern=equals.Equality)  # -> ListA, ListB
dispatch_3 = Dispatch(List=crv_2, DispatchPattern=equals_2.Equality)  # -> ListA, ListB
lng_2 = ListLength(List=ln)
int_brige_variarion_3 = Integer(int_brige_variarion)
geo = Geometry(flatten(dispatch.ListA))
geo_2 = Geometry(dispatch_2.ListA)
geo_3 = Geometry(dispatch_3.ListA)
multiplication_4 = Multiplication(A=lng_2, B="0.9")
area_2 = Area(Geometry=geo_2)  # -> Area, Centroid
area_3 = Area(Geometry=geo)  # -> Area, Centroid
avr = Average()
area_4 = Area(Geometry=geo_3)  # -> Area, Centroid
reduce_2 = RandomReduce(List=ln, Reduction=multiplication_4, Seed=int_brige_variarion_3)
sort_pt = SortPoints(Points=area_2.Centroid)  # -> Points, Indices
deconstruct_vector = DeconstructVector(Vector=reduce_2)  # -> XComponent, YComponent, ZComponent
larger = LargerThan(SecondNumber=avr)  # -> LargerThan, OrEqualTo
sort_pt_2 = SortPoints(Points=area_3.Centroid)  # -> flatten(Points), Indices
sort_pt_3 = SortPoints(Points=area_4.Centroid)  # -> Points, Indices
pline = PolyLine(Vertices=sort_pt.Points, Closed=False)
dispatch_4 = Dispatch(DispatchPattern=larger.LargerThan)  # -> ListA, ListB
cp = ClosestPoint(Point=sort_pt_2.Points, Cloud=sort_pt_2.Points)  # -> ClosestPoint, CPIndex, Distance
pline_2 = PolyLine(Vertices=sort_pt_3.Points, Closed=False)
crv_4 = Curve(pline)
abs = Absolute(Value=deconstruct_vector.XComponent)
abs_2 = Absolute(Value=deconstruct_vector.YComponent)
abs_3 = Absolute(Value=deconstruct_vector.ZComponent)
ln_2 = Line(StartPoint=dispatch_4.ListA, EndPoint=dispatch_4.ListB)
inter = InterconnectPoints(Pts=sort_pt_3.Points)
pline_3 = PolyLine(Vertices=cp.ClosestPoint, Closed=False)
crv_5 = Curve(pline_2)
ln_3 = Line(StartPoint=cp.ClosestPoint, EndPoint=sort_pt_2.Points)
absolute = Absolute(Value=deconstruct_vector.ZComponent)
viewer = ParamViewer(cp.Distance)
crv_6 = Curve(inter)
crv_7 = Curve(pline_3)
deconstruct_vector_2 = DeconstructVector(Vector=ln_2)  # -> XComponent, YComponent, ZComponent
smaller_than = SmallerThan(FirstNumber=absolute, SecondNumber=Slider(0, range=0..1))  # -> SmallerThan, OrEqualTo
crv_8 = Curve(crv_6)
crv_9 = Curve(crv_4)
abs_4 = Absolute(Value=deconstruct_vector_2.XComponent)
abs_5 = Absolute(Value=deconstruct_vector_2.YComponent)
abs_6 = Absolute(Value=deconstruct_vector_2.ZComponent)
explode = Explode(Curve=crv_7, Recursive=True)  # -> Segments, Vertices
cull_pattern = CullPattern(List=reduce_2, CullPattern=smaller_than.OrEqualTo)
absolute_2 = Absolute(Value=deconstruct_vector_2.ZComponent)
len = Length(Curve=explode.Segments)
crv_10 = Curve(cull_pattern)
sort = SortList(Keys=len)  # -> Keys, ValuesA
lng_3 = ListLength(List=len)
len_2 = Length(Curve=crv_9)
smaller_than_2 = SmallerThan(FirstNumber=absolute_2, SecondNumber=Slider(0, range=0..1))  # -> SmallerThan, OrEqualTo
division = Division(A=lng_3, B="3")
avr_2 = Average(Input=len_2)
split = SplitList(List=sort.Keys, Index=division)  # -> ListA, ListB
addition = Addition(A=avr_2, B="350")
subtraction = Subtraction(A=avr_2, B="350")
num = Number(split.ListA)
cull_pattern_2 = CullPattern(List=ln_2, CullPattern=smaller_than_2.OrEqualTo)
max = Maximum(A=num, B=num)
num_bridge_width = ClusterInput()
num_bridge_height = Number("150")
division_2 = Division(A=num_bridge_height, B=150)
sqrt = SquareRoot(Value=division_2)

geo_4 = Geometry(explode.Segments)
len_3 = Length(Curve=geo_4)  # -> flatten(Length)
smaller = SmallerThan(FirstNumber=len_3, SecondNumber=max)  # -> SmallerThan, OrEqualTo
dispatch_5 = Dispatch(List=geo_4, DispatchPattern=smaller.OrEqualTo)  # -> ListA, ListB
geo_5 = Geometry(graft(geo_4))
num_bridge_width_2 = Number(num_bridge_width)
division_3 = Division(A=num_bridge_width_2, B=sqrt)
offset = OffsetCurve(Curve=geo_5, Distance=division_3, Plane=PlaneXY(0, 0, 0), Corners=1)
offset_2 = OffsetCurve(Curve=geo_5, Distance=expr("-x", division_3), Plane=PlaneXY(0, 0, 0), Corners=1)
rulesrf = RuledSurface(CurveA=offset_2, CurveB=offset)
geo_6 = Geometry(rulesrf)
panel = Panel(geo_6)
geo_7 = ClusterOutput(geo_5)

len_4 = Length(Curve=geo_5)
num_bridge_height_2 = Number("600")
panel_2 = Panel(offset_2)
division_4 = Division(A=num_bridge_height_2, B=150)
sqrt_2 = SquareRoot(Value=division_4)
brep = ClusterInput()
brep_2 = Brep(flatten([geo_bridge_building, brep]))

len_5 = Length(Curve=crv_8)
geo_8 = Geometry(crv_8)
sort_2 = SortList(Keys=len_5)  # -> Keys, ValuesA
lng_4 = ListLength(List=len_5)
division_5 = Division(A=lng_4, B="5")
split_2 = SplitList(List=sort_2.Keys, Index=division_5)  # -> ListA, ListB
len_6 = Length(Curve=geo_8)  # -> flatten(Length)
num_2 = Number(split_2.ListA)
max_2 = Maximum(A=num_2, B=num_2)
smaller_2 = SmallerThan(FirstNumber=len_6, SecondNumber=max_2)  # -> SmallerThan, OrEqualTo
dispatch_6 = Dispatch(List=geo_8, DispatchPattern=smaller_2.OrEqualTo)  # -> ListA, ListB
geo_9 = Geometry(graft(dispatch_6.ListA))
num_bridge_height_3 = Number("450")
division_6 = Division(A=num_bridge_height_3, B=150)
sqrt_3 = SquareRoot(Value=division_6)
num_bridge_width_3 = Number(num_bridge_width)
division_7 = Division(A=num_bridge_width_3, B=sqrt_3)

crv_11 = Curve(flatten(geo_9))
curvepoint_2 = PointOnCurve(crv_11, parameter=0.5)
pt_2 = Point(curvepoint_2)
pdecon_2 = Deconstruct(Point=pt_2)  # -> XComponent, YComponent, ZComponent
larger_2 = LargerThan(FirstNumber=pdecon_2.ZComponent, SecondNumber="150")  # -> LargerThan, OrEqualTo
dispatch_7 = Dispatch(List=crv_11, DispatchPattern=larger_2.LargerThan)  # -> ListA, ListB
geo_10 = Geometry(dispatch_7.ListA)

geo_11 = Geometry(graft(geo_10))
geo_12 = ClusterOutput(geo_11)
offset_3 = OffsetCurve(Curve=geo_11, Distance=division_7, Plane=PlaneXY(0, 0, 0), Corners=1)
offset_4 = OffsetCurve(Curve=geo_11, Distance=expr("-x", division_7), Plane=PlaneXY(0, 0, 0), Corners=1)
rulesrf_2 = RuledSurface(CurveA=offset_4, CurveB=offset_3)
geo_13 = Geometry(rulesrf_2)

geo_14 = Geometry(crv_9)
len_7 = Length(Curve=geo_14)
smaller_3 = SmallerThan(FirstNumber=len_7, SecondNumber=addition)  # -> SmallerThan, OrEqualTo
dispatch_8 = Dispatch(List=geo_14, DispatchPattern=smaller_3.SmallerThan)  # -> ListA, ListB
larger_3 = LargerThan(FirstNumber=dispatch_8.ListA, SecondNumber=subtraction)  # -> LargerThan, OrEqualTo
dispatch_9 = Dispatch(List=dispatch_8.ListA, DispatchPattern=larger_3.LargerThan)  # -> ListA, ListB
num_bridge_width_4 = Number(num_bridge_width)
division_8 = Division(A=num_bridge_width_4, B=sqrt_2)

geo_15 = Geometry(graft(dispatch_9.ListA))

crv_12 = Curve(flatten(geo_15))
curvepoint_3 = PointOnCurve(crv_12, parameter=0.5)
pt_3 = Point(curvepoint_3)
pdecon_3 = Deconstruct(Point=pt_3)  # -> XComponent, YComponent, ZComponent
larger_4 = LargerThan(FirstNumber=pdecon_3.ZComponent, SecondNumber="150")  # -> LargerThan, OrEqualTo
dispatch_10 = Dispatch(List=crv_12, DispatchPattern=larger_4.LargerThan)  # -> ListA, ListB
geo_16 = Geometry(dispatch_10.ListA)

geo_17 = Geometry(graft(geo_16))
geo_18 = ClusterOutput(geo_17)
offset_5 = OffsetCurve(Curve=geo_17, Distance=division_8, Plane=PlaneXY(0, 0, 0), Corners=1)
offset_6 = OffsetCurve(Curve=geo_17, Distance=expr("-x", division_8), Plane=PlaneXY(0, 0, 0), Corners=1)
rulesrf_3 = RuledSurface(CurveA=offset_6, CurveB=offset_5)
geo_19 = Geometry(rulesrf_3)
viewer_2 = ParamViewer(geo_19)

geo_20 = Geometry([geo_6, geo_19, geo_13])
trim = TrimSolid(Shape=geo_20, Cutters=brep_2)
R = ClusterOutput(trim)
