# Grasshopper definition Tower with Balconies for Optimal Daylight.gh (Grasshopper 1.0.6)

# ----
# XIM Standards
# Inputs
data = Data(True)

far_list = Panel("""18
20
22
24
26
28
30
32
34""")
tower_footprint_one_side_set_back_ratio = Panel("0.2")
tower_footprint_general_offset_ratio = Panel("0.12")
podium_height = Panel("60")
interval_n_of_floors_btw_balconies = Panel("3")
floor_to_floor_height = Panel("15")
balcony_depth = Panel("20")
base_crv = Curve(simplify(graft([<curve referenced from the Rhino model> x9])))

# ----
# Ouputs
data_2 = Data(True)

# ----
# Lot Sequence Check
number_slider = Slider(0, range=0..20)
item = ListItem(List=flatten(base_crv), Index=number_slider, Wrap=True)

# ----
# Note
# Actions
# DO NOT CHANGE
# Previews
note_panel = Panel("")

brep_maker = BrepMaker(
    base_crv=base_crv,
    tower_footprint_one_side_set_back_ratio=tower_footprint_one_side_set_back_ratio,
    tower_footprint_general_offset_ratio=tower_footprint_general_offset_ratio,
    num_podium_height=podium_height,
    num_balcony_depth=balcony_depth,
    num_interval_flr_num=interval_n_of_floors_btw_balconies,
    num_far_list=far_list,
    num_flr_to_flr_height=floor_to_floor_height)  # -> brep_podium_2, brep_tower_2
merge = Merge(Data1=brep_maker.brep_podium_2, Data2=brep_maker.brep_tower_2)
sunion = SolidUnion(Breps=merge)
brep_podiumtower = Brep(sunion)

# ----
# Preview
swatch = ColourSwatch(SwatchColor=RGB(255, 255, 255))
edges = BrepEdges(Brep=brep_podiumtower)  # -> Naked, Interior, NonManifold
preview = CustomPreview(Geometry=brep_podiumtower, Material=swatch)
preview_2 = CustomPreview(Geometry=edges.Interior, Material=ColourSwatch(SwatchColor=RGB(0, 0, 0)))

# ==== cluster BrepMaker
base_crv = ClusterInput()
tower_footprint_one_side_set_back_ratio = ClusterInput()
tower_footprint_general_offset_ratio = ClusterInput()
num_podium_height = ClusterInput()
num_balcony_depth = ClusterInput()
num_interval_flr_num = ClusterInput()
num_far_list = ClusterInput()
num_flr_to_flr_height = ClusterInput()
tower_footprint_one_side_set_back_ratio_2 = Number(tower_footprint_one_side_set_back_ratio)
tower_footprint_general_offset_ratio_2 = Number(tower_footprint_general_offset_ratio)
num_balcony_depth_2 = Number(num_balcony_depth)
num_interval_flr_num_2 = Number(num_interval_flr_num)
num_flr_to_flr_height_2 = Number(num_flr_to_flr_height)
num_podium_height_2 = Number(num_podium_height)
num_far_list_2 = Number(simplify(graft(num_far_list)))
base_crv_2 = Curve(base_crv)
simplify = SimplifyCurve(Curve=base_crv_2)  # -> Curve, Simplified
tower_footprint = TowerFootprint(
    crv=simplify.Curve,
    set_back_ratio=tower_footprint_one_side_set_back_ratio_2,
    offset_ratio=tower_footprint_general_offset_ratio_2)
integer_division = IntegerDivision(A=num_podium_height_2, B=num_flr_to_flr_height_2)
crv = Curve(simplify.Curve)
crv_2 = Curve(base_crv_2)
subtraction = Subtraction(A=num_far_list_2, B=integer_division)
Z = UnitZ(Factor=num_podium_height_2)
boundary = BoundarySurfaces(Edges=graft(crv))  # -> simplify(Surfaces)
area = Area(Geometry=crv_2)  # -> Area, Centroid
multiplication = Multiplication(A=subtraction, B=area.Area)
move = Move(Geometry=simplify(tower_footprint), Motion=Z)  # -> Geometry, Transform
extr = Extrude(Base=boundary, Direction=Z)
tower_footprint_2 = Curve(move.Geometry)
balcony_footprint = BalconyFootprint(tower_footprint=tower_footprint_2, balcony_depth=num_balcony_depth_2)
balcony_footprint_2 = Curve(balcony_footprint)
tower_footprint_3 = Curve(tower_footprint_2)
merge = Merge(Data1=tower_footprint_3, Data2=balcony_footprint_2)
area_2 = Area(Geometry=merge)  # -> Area, Centroid
avr = Average(Input=area_2.Area)
integer_division_2 = IntegerDivision(A=multiplication, B=avr)
cluster = Cluster(
    balcony_footprint=balcony_footprint_2,
    tower_footprint=tower_footprint_3,
    interval_floor_num=num_interval_flr_num_2,
    num_tower_floor_num=integer_division_2,
    flr_to_flr_height=num_flr_to_flr_height_2)
brep_podium = Brep(extr)
brep_tower = Brep(cluster)
brep_tower_2 = ClusterOutput(brep_tower)
brep_podium_2 = ClusterOutput(brep_podium)

# ==== cluster TowerFootprint
crv = ClusterInput()
crv_2 = Curve(crv)
explode = Explode(Curve=crv_2, Recursive=True)  # -> Segments, Vertices
lng = ListLength(List=explode.Segments)
offset_ratio = ClusterInput()
larger = LargerThan(FirstNumber=lng, SecondNumber=4)  # -> LargerThan, OrEqualTo
set_back_ratio = ClusterInput()
offset_ratio_2 = Number(offset_ratio)
set_back_ratio_2 = Number(set_back_ratio)
dispatch = Dispatch(List=crv_2, DispatchPattern=larger.LargerThan)  # -> ListA, ListB
explode_2 = Explode(Curve=dispatch.ListA, Recursive=True)  # -> Segments, Vertices
crv_3 = Curve(dispatch.ListB)
len = Length(Curve=explode_2.Segments)
explode_3 = Explode(Curve=crv_3, Recursive=True)  # -> Segments, Vertices
boundary = BoundarySurfaces(Edges=crv_3)
sort = SortList(Keys=len, ValuesA=explode_2.Segments)  # -> Keys, ValuesA
rev = ReverseList(List=sort.ValuesA)
len_2 = Length(Curve=explode_3.Segments)
split = SplitList(List=rev, Index="2")  # -> ListA, ListB
sort_2 = SortList(Keys=len_2, ValuesA=explode_3.Segments)  # -> Keys, ValuesA
crv_4 = Curve(split.ListA)
item = ListItem(List=sort_2.ValuesA, Index=0, Wrap=True)
join = JoinCurves(Curves=crv_4, Preserve=False)
index = ItemIndex(List=explode_3.Segments, Item=item)
addition = Addition(A=index, B=2)
lng_2 = ListLength(List=join)
item_2 = ListItem(List=explode_3.Segments, Index=index, Wrap=True)
item_3 = ListItem(List=explode_3.Segments, Index=addition, Wrap=True)
eval = Evaluate(F="if(x=1, 0, 1)", x=lng_2)
flip = FlipCurve(Curve=item_2)  # -> Curve, Flag
num = Number(set_back_ratio_2)
dispatch_2 = Dispatch(List=join, DispatchPattern=eval)  # -> ListA, ListB
tweencrv = TweenCurve(CurveA=flip.Curve, CurveB=item_3, Factor=num, BlendType=0)
crv_5 = Curve(dispatch_2.ListB)
crv_6 = Curve(dispatch_2.ListA)
explode_4 = Explode(Curve=simplify(crv_5), Recursive=True)  # -> Segments, Vertices
srfsplit = SurfaceSplit(Surface=boundary, Curves=tweencrv)
item_4 = ListItem(List=srfsplit, Index="1", Wrap=True)
len_3 = Length(Curve=explode_4.Segments)
sort_3 = SortList(Keys=len_3, ValuesA=explode_4.Segments)  # -> Keys, ValuesA
rev_2 = ReverseList(List=sort_3.ValuesA)
split_2 = SplitList(List=rev_2, Index="1")  # -> ListA, ListB
crv_7 = Curve(item_4)
crv_8 = Curve(split_2.ListB)
crv_9 = Curve(split_2.ListA)
end = EndPoints(Curve=crv_9)  # -> Start, End
end_2 = EndPoints(Curve=crv_8)  # -> Start, End
frame = CurveFrame(Curve=reparameterize(crv_9), Parameter="0.5")
frame_2 = CurveFrame(Curve=reparameterize(crv_9), Parameter="0.5")
merge = Merge(Data1=end.Start, Data2=end.End)
merge_2 = Merge(Data1=end_2.Start, Data2=end_2.End)
difference = SetDifference(SetA=merge, SetB=merge_2)
difference_2 = SetDifference(SetA=merge_2, SetB=merge)
expression = Expression(x=num, Expression="(1-x)*0.8")
connect = ConnectCurves(Curves=crv_6, Continuity=0, Close=True, Bulge=1)
rec_2pt = Rectangle2Pt(Plane=frame_2, PointA=difference, PointB=difference_2, Radius=0)  # -> Rectangle, Length
scale_nu = ScaleNU(Geometry=rec_2pt.Rectangle, Plane=frame, ScaleX=1, ScaleY=expression, ScaleZ=1)  # -> Geometry, Transform
panel = Panel(expression)
offset = OffsetCurve(Curve=scale_nu.Geometry, Distance="10", Plane=PlaneXY(0, 0, 0), Corners=1)
explode_5 = Explode(Curve=offset, Recursive=True)  # -> Segments, Vertices
item_5 = ListItem(List=explode_5.Vertices, Index=0, Wrap=True)
incurve = PointInCurve(Point=item_5, Curve=scale_nu.Geometry)  # -> Relationship, Point
dispatch_3 = Dispatch(List=scale_nu.Geometry, DispatchPattern=incurve.Relationship)  # -> ListA, ListB
crv_10 = Curve(dispatch_3.ListB)
flip_2 = FlipCurve(Curve=crv_10)  # -> Curve, Flag
crv_11 = Curve(dispatch_3.ListA)
merge_3 = Merge(Data1=crv_11, Data2=flip_2.Curve)
merge_4 = Merge(Data1=simplify(connect), Data2=simplify(merge_3), Data3=simplify(crv_7))
null = NullItem(Item=merge_4)  # -> NullFlags, InvalidFlags, Description
not = GateNot(A=null.NullFlags)
cull = CullPattern(List=merge_4, CullPattern=not)
panel_2 = Panel(cull)
crv_12 = Curve(cull)
explode_6 = Explode(Curve=crv_12, Recursive=True)  # -> Segments, Vertices
panel_3 = Panel("""1
3""")
len_4 = Length(Curve=explode_6.Segments)
sort_4 = SortList(Keys=len_4, ValuesA=explode_6.Segments)  # -> Keys, ValuesA
item_6 = ListItem(List=sort_4.Keys, Index=panel_3, Wrap=True)
avr = Average(Input=item_6)
multiplication = Multiplication(A=avr, B=offset_ratio_2)  # -> simplify(Result)
int = Integer(multiplication)
offset_2 = OffsetCurve(Curve=cull, Distance=int, Plane=PlaneXY(0, 0, 0), Corners=1)
tower_footprint = Curve(offset_2)
tower_footprint_2 = ClusterOutput(tower_footprint)

# ==== cluster BalconyFootprint
tower_footprint = ClusterInput()
balcony_depth = ClusterInput()
tower_footprint_2 = Curve(tower_footprint)
balcony_depth_2 = Number(balcony_depth)
Y = UnitY(Factor=balcony_depth_2)

# ----
# Sun Shading
panel = Panel("-1")
vec = VectorXYZ(XComponent="0", YComponent=panel, ZComponent=0)  # -> Vector, Length
simplify = SimplifyCurve(Curve=tower_footprint_2)  # -> Curve, Simplified
explode = Explode(Curve=simplify.Curve, Recursive=True)  # -> Segments, Vertices
crv = Curve(explode.Segments)
frame = CurveFrame(Curve=reparameterize(crv), Parameter=0.5)
curvepoint = PointOnCurve(crv, parameter=0.5)
deplane = DeconstructPlane(Plane=frame)  # -> Origin, XAxis, YAxis, ZAxis
unit = UnitVector(Vector=deplane.YAxis)
move = Move(Geometry=curvepoint, Motion=unit)  # -> Geometry, Transform
incurve = PointInCurve(Point=move.Geometry, Curve=simplify.Curve)  # -> Relationship, Point
bool = Boolean(incurve.Relationship)
dispatch = Dispatch(List=crv, DispatchPattern=bool)  # -> ListA, ListB
flip = FlipCurve(Curve=dispatch.ListA)  # -> Curve, Flag
merge = Merge(Data1=flip.Curve, Data2=dispatch.ListB)
frame_2 = CurveFrame(Curve=reparameterize(merge), Parameter=0.5)
deplane_2 = DeconstructPlane(Plane=frame_2)  # -> Origin, XAxis, YAxis, ZAxis
vec_2 = Vector(deplane_2.YAxis)
angle = Angle(VectorA=vec.Vector, VectorB=vec_2)  # -> Angle, Reflex
sort = SortList(Keys=angle.Reflex, ValuesA=merge)  # -> Keys, ValuesA
panel_2 = Panel(angle.Reflex)
rev = ReverseList(List=sort.ValuesA)
split = SplitList(List=rev, Index="2")  # -> ListA, ListB
vdis = VectorDisplay(Anchor=deplane_2.Origin, Vector=vec_2)
crv_2 = Curve(split.ListA)
join = JoinCurves(Curves=split.ListB, Preserve=False)
join_2 = JoinCurves(Curves=crv_2, Preserve=False)
ext = ExtendCurve(Curve=join_2, Type=0, Start="80", End="80")
ext_2 = ExtendCurve(Curve=join, Type=0, Start="80", End="80")  # -> simplify(Curve)
move_2 = Move(Geometry=ext, Motion=Y)  # -> simplify(Geometry), Transform
ccx = CurveCurve(CurveA=ext_2, CurveB=move_2.Geometry)  # -> Points, ParamsA, ParamsB
item = ListItem(List=ccx.ParamsA, Index=0, Wrap=True)
item_2 = ListItem(List=ccx.ParamsA, Index=1, Wrap=True)
item_3 = ListItem(List=ccx.ParamsB, Index=0, Wrap=True)
item_4 = ListItem(List=ccx.ParamsB, Index=1, Wrap=True)
dom = ConstructDomain(DomainStart=item, DomainEnd=item_2)  # -> simplify(Domain)
dom_2 = ConstructDomain(DomainStart=item_3, DomainEnd=item_4)  # -> simplify(Domain)
subcrv = SubCurve(BaseCurve=ext_2, Domain=dom)
subcrv_2 = SubCurve(BaseCurve=move_2.Geometry, Domain=dom_2)
join_3 = JoinCurves(Curves=[subcrv, subcrv_2], Preserve=False)

crv_3 = Curve(simplify(join_3))
crv_4 = ClusterOutput(crv_3)

# ==== cluster Cluster
interval_floor_num = ClusterInput()
num_tower_floor_num = ClusterInput()
flr_to_flr_height = ClusterInput()
balcony_footprint = ClusterInput()
tower_footprint = ClusterInput()
balcony_footprint_2 = Curve(simplify(balcony_footprint))
tower_footprint_2 = Curve(tower_footprint)
num_tower_floor_num_2 = Number(flatten(num_tower_floor_num))
interval_floor_num_2 = Integer(interval_floor_num)
flr_to_flr_height_2 = Number(flr_to_flr_height)
int = Integer(num_tower_floor_num_2)
python = GhPythonScript(x=int, y=interval_floor_num_2)  # -> out, move_n, typ_n, simplify(graft(top_h)); inputs x: list of Int32, y: Int32
# ---------- python: Python ----------
import math

move_n = []
typ_n = []
top_h = []
for i in x:
    move_n.append(math.ceil(i/y))
    typ_n.append(i//y)
    top_h.append(i % y)
# ---------- end python ----------
multiplication = Multiplication(A=interval_floor_num_2, B=flr_to_flr_height_2)
dup = DuplicateData(Data=multiplication, Number=python.typ_n, Order=True)  # -> simplify(Data)
cull = CullPattern(List=python.top_h, CullPattern=python.top_h)
multiplication_2 = Multiplication(A=cull, B=flr_to_flr_height_2)
series = Series(Start=0, Step=multiplication, Count=python.move_n)  # -> simplify(Series)
merge = Merge(Data1=dup, Data2=multiplication_2)  # -> simplify(Result)
dispatch = Dispatch(List=series, DispatchPattern=[False, True])  # -> ListA, ListB
dispatch_2 = Dispatch(List=merge, DispatchPattern=[False, True])  # -> ListA, ListB
Z = UnitZ(Factor=dispatch.ListA)
Z_2 = UnitZ(Factor=dispatch.ListB)
Z_3 = UnitZ(Factor=dispatch_2.ListA)
Z_4 = UnitZ(Factor=dispatch_2.ListB)
boundary = BoundarySurfaces(Edges=balcony_footprint_2)
boundary_2 = BoundarySurfaces(Edges=tower_footprint_2)
move = Move(Geometry=boundary, Motion=Z)  # -> Geometry, Transform
move_2 = Move(Geometry=boundary_2, Motion=Z_2)  # -> Geometry, Transform
extr = Extrude(Base=move.Geometry, Direction=Z_3)
extr_2 = Extrude(Base=move_2.Geometry, Direction=Z_4)
merge_2 = Merge(Data1=extr, Data2=extr_2)
sunion = SolidUnion(Breps=merge_2)
R = ClusterOutput(sunion)
