# Grasshopper definition stackedtower.gh (Grasshopper 1.0.7)

int_tower_type = Integer(Slider(1, range=0..3))
geo_lots = Geometry(<curve referenced from the Rhino model>)
int_far = Integer(3)
pt_north = Point(<point referenced from the Rhino model>)
towers = Towers(geo_lots=geo_lots, int_tower_type=int_tower_type, int_far=int_far, pt_north=pt_north)
geo_tower = Geometry(towers)
cluster = Cluster(brep=geo_tower)  # -> srf_garden_2, geo_wall_2
geo_garden = Geometry(cluster.srf_garden_2)
geo_wall = Geometry(cluster.geo_wall_2)
edges = BrepEdges(Brep=cluster.geo_wall_2)  # -> Naked, Interior, NonManifold
preview = CustomPreview(Geometry=geo_garden, Material=ColourSwatch(SwatchColor=RGB(162, 224, 99)))
preview_2 = CustomPreview(Geometry=geo_wall, Material=ColourSwatch(SwatchColor=RGB(255, 255, 255)))
preview_3 = CustomPreview(Geometry=edges.Naked, Material=ColourSwatch(SwatchColor=RGB(0, 0, 0)))

# ==== cluster Towers
pt_north = ClusterInput()
geo_lots = ClusterInput()
int_far = ClusterInput()
int_tower_type = ClusterInput()
pt_north_2 = Point(pt_north)
geo_lots_2 = Geometry(geo_lots)
int_tower_type_2 = Integer(int_tower_type)
int_far_2 = Integer(int_far)
lng = ListLength(List=geo_lots_2)
random = Random(Range=Domain(-1, 1), Number=lng, Seed=2)
addition = Addition(A=random, B=int_far_2)
int_far_3 = Integer(int_far_2)
gate = StreamGate(Stream=geo_lots_2, Gate=int_tower_type_2)  # -> Target0, Target1, Target2, Target3
parcel = Curve(gate.Target0)
far = Panel(int_far_3)
parcel_2 = Curve(gate.Target1)
parcel_3 = Curve(gate.Target3)
parcel_4 = Curve(gate.Target2)
far_2 = Panel(int_far_3)
far_3 = Panel(int_far_3)
far_4 = Panel(int_far_3)
tower_stacked = TowerStacked(crv=parcel_2, num=far_3, north=pt_north_2)
tower_stepped = TowerStepped(crv=parcel, num=far, north=pt_north_2)
tower_offset = TowerOffset(crv=parcel_4, num=far_4)
tower_balcony = TowerBalcony(crv=parcel_3, num=far_2)
geo = Geometry(tower_stepped)
geo_2 = Geometry(tower_stacked)
geo_3 = Geometry(tower_offset)
geo_4 = Geometry(tower_balcony)
merge = Merge(Data1=geo, Data2=geo_2, Data3=geo_3, Data4=geo_4)
geo_tower = Geometry(merge)
geo_tower_2 = ClusterOutput(geo_tower)

# ==== cluster Cluster
brep = ClusterInput()
brep_2 = Brep(brep)
debrep = DeconstructBrep(Brep=brep_2)  # -> Faces, Edges, Vertices
evalsrf = EvaluateSurface(Surface=reparameterize(debrep.Faces), Point="{0.5,0.5,0}")  # -> Point, Normal, UDirection, VDirection, Frame
devec = DeconstructVector(Vector=evalsrf.Normal)  # -> XComponent, YComponent, ZComponent
abs = Absolute(Value=devec.ZComponent)
smaller = SmallerThan(FirstNumber=devec.ZComponent, SecondNumber="1")  # -> SmallerThan, OrEqualTo
dispatch = Dispatch(List=debrep.Faces, DispatchPattern=smaller.SmallerThan)  # -> ListA, ListB
outpt_cap = Surface(dispatch.ListB)
srf_garden = Surface(outpt_cap)
geo_wall = Geometry(dispatch.ListA)
srf_garden_2 = ClusterOutput(srf_garden)
geo_wall_2 = ClusterOutput(geo_wall)

# ==== cluster TowerBalcony
crv = ClusterInput()
base_scale = Slider(0.9, range=0..1)
num = ClusterInput()
crv_2 = Curve(crv)
num_2 = Number(num)
area = Area(Geometry=crv_2)  # -> Area, Centroid
pcen = PolygonCenter(Polyline=crv_2)  # -> CenterV, CenterE, CenterA
floor = Slider(11, range=0..100)
number_slider = Slider(2, range=0..10)
scale = Scale(Geometry=crv_2, Center=pcen.CenterV, Factor=base_scale)  # -> Geometry, Transform
multiplication = Multiplication(A=num_2, B=area.Area)
multiplication_2 = Multiplication(A=floor, B=number_slider)
boundary = BoundarySurfaces(Edges=scale.Geometry)
area_2 = Area(Geometry=boundary)  # -> Area, Centroid
Z = UnitZ(Factor=multiplication_2)
geo = Geometry(scale.Geometry)
multiplication_3 = Multiplication(A=area_2.Area, B=number_slider)
extr = Extrude(Base=boundary, Direction=Z)
subtraction = Subtraction(A=multiplication, B=multiplication_3)
move = Move(Geometry=boundary, Motion=Z)  # -> Geometry, Transform
pcen_2 = PolygonCenter(Polyline=move.Geometry)  # -> CenterV, CenterE, CenterA
move_2 = Move(Geometry=geo, Motion=Z)  # -> Geometry, Transform
scale_2 = Scale(Geometry=move.Geometry, Center=pcen_2.CenterV, Factor=Slider(0.6, range=0..1))  # -> Geometry, Transform
area_3 = Area(Geometry=scale_2.Geometry)  # -> Area, Centroid
division = Division(A=subtraction, B=area_3.Area)
geo_2 = Geometry(scale_2.Geometry)
int = Integer(division)
multiplication_4 = Multiplication(A=floor, B=int)
pcen_3 = PolygonCenter(Polyline=move_2.Geometry)  # -> CenterV, CenterE, CenterA
Z_2 = UnitZ(Factor=multiplication_4)
extr_2 = Extrude(Base=scale_2.Geometry, Direction=Z_2)
scale_3 = Scale(Geometry=move_2.Geometry, Center=pcen_3.CenterV, Factor=Slider(0.75, range=0..1))  # -> Geometry, Transform
geo_3 = Geometry(extr)
scale_4 = Scale(Geometry=move_2.Geometry, Center=pcen_2.CenterV, Factor=Slider(0.6, range=0..1))  # -> Geometry, Transform
series = Series(Start=floor, Step=floor, Count=expr("x-1", int))
graft = GraftTree(Tree=scale_4.Geometry, IncludeEmptyLists=True, IncludeNullItems=True)
graft_2 = GraftTree(Tree=scale_3.Geometry, IncludeEmptyLists=True, IncludeNullItems=True)
Z_3 = UnitZ(Factor=series)
merge = Merge(Data1=graft, Data2=graft_2)
loft = Loft(Curves=merge, Options={Adjust=False, Closed=False, LoftEnds=0, LoftSimp=0, LoftType=0, Rebuild=10, Refit=0.01})
move_3 = Move(Geometry=loft, Motion=Z_3)  # -> Geometry, Transform
merge_2 = Merge(Data1=extr_2, Data2=geo_3, Data3=move_3.Geometry)
sunion = SolidUnion(Breps=merge_2)  # -> flatten(Result)
R = ClusterOutput(sunion)

# ==== cluster TowerOffset
crv = ClusterInput()
base_scale = Slider(0.9, range=0..1)
num = ClusterInput()
crv_2 = Curve(crv)
num_2 = Number(num)
area = Area(Geometry=crv_2)  # -> Area, Centroid
pcen = PolygonCenter(Polyline=crv_2)  # -> CenterV, CenterE, CenterA
floor = Slider(11, range=0..100)
number_slider = Slider(2, range=0..10)
scale = Scale(Geometry=crv_2, Center=pcen.CenterV, Factor=base_scale)  # -> Geometry, Transform
multiplication = Multiplication(A=num_2, B=area.Area)
multiplication_2 = Multiplication(A=floor, B=number_slider)
boundary = BoundarySurfaces(Edges=scale.Geometry)
area_2 = Area(Geometry=boundary)  # -> Area, Centroid
Z = UnitZ(Factor=multiplication_2)
multiplication_3 = Multiplication(A=area_2.Area, B=number_slider)
extr = Extrude(Base=boundary, Direction=Z)
move = Move(Geometry=boundary, Motion=Z)  # -> Geometry, Transform
subtraction = Subtraction(A=multiplication, B=multiplication_3)
pcen_2 = PolygonCenter(Polyline=move.Geometry)  # -> CenterV, CenterE, CenterA
scale_2 = Scale(Geometry=move.Geometry, Center=pcen_2.CenterV, Factor=Slider(0.6, range=0..1))  # -> Geometry, Transform
area_3 = Area(Geometry=scale_2.Geometry)  # -> Area, Centroid
division = Division(A=subtraction, B=area_3.Area)
int = Integer(division)
multiplication_4 = Multiplication(A=floor, B=int)
Z_2 = UnitZ(Factor=multiplication_4)
extr_2 = Extrude(Base=scale_2.Geometry, Direction=Z_2)
geo = Geometry(extr)
merge = Merge(Data1=extr_2, Data2=geo)
sunion = SolidUnion(Breps=merge)
R = ClusterOutput(sunion)

# ==== cluster TowerStacked
crv = ClusterInput()
north = ClusterInput()
number_slider = Slider(0.75, range=0..1)
number_slider_2 = Slider(0.6, range=0..1)
crv_2 = Curve(crv)
num = ClusterInput()
north_2 = Point(north)
num_2 = Number(num)
pln = Plane(crv_2)
floor = Slider(11, range=0..100)
scale_nu = ScaleNU(Geometry=crv_2, Plane=pln, ScaleX=number_slider, ScaleY=number_slider_2, ScaleZ=1)  # -> Geometry, Transform
scale_nu_2 = ScaleNU(Geometry=crv_2, Plane=pln, ScaleX=number_slider_2, ScaleY=number_slider, ScaleZ=1)  # -> Geometry, Transform
pcen = PolygonCenter(Polyline=crv_2)  # -> CenterV, CenterE, CenterA
pcen_2 = PolygonCenter(Polyline=scale_nu_2.Geometry)  # -> CenterV, CenterE, CenterA
pcen_3 = PolygonCenter(Polyline=scale_nu.Geometry)  # -> CenterV, CenterE, CenterA
boundary = BoundarySurfaces(Edges=crv_2)
vec2pt = Vector2Pt(PointA=pcen_3.CenterV, PointB=pcen.CenterV, Unitize=False)  # -> Vector, Length
area = Area(Geometry=boundary)  # -> Area, Centroid
vec2pt_2 = Vector2Pt(PointA=pcen_2.CenterV, PointB=pcen.CenterV, Unitize=False)  # -> Vector, Length
move = Move(Geometry=scale_nu.Geometry, Motion=vec2pt.Vector)  # -> Geometry, Transform
move_2 = Move(Geometry=scale_nu_2.Geometry, Motion=vec2pt_2.Vector)  # -> Geometry, Transform
explode = Explode(Curve=move.Geometry, Recursive=True)  # -> Segments, Vertices
explode_2 = Explode(Curve=move_2.Geometry, Recursive=True)  # -> Segments, Vertices
boundary_2 = BoundarySurfaces(Edges=move_2.Geometry)
area_2 = Area(Geometry=boundary_2)  # -> Area, Centroid
division = Division(A=area_2.Area, B=area.Area)
division_2 = Division(A=num_2, B=division)
multiplication = Multiplication(A=division_2, B=floor)
pull = PullPoint(Point=north_2, Geometry=explode_2.Vertices, ClosestOnly=True)  # -> ClosestPoint, Distance
pull_2 = PullPoint(Point=north_2, Geometry=explode.Vertices, ClosestOnly=True)  # -> ClosestPoint, Distance
division_3 = Division(A=multiplication, B=Slider(5, range=0..10))
Z = UnitZ(Factor=division_3)
vec2pt_3 = Vector2Pt(PointA=pull_2.ClosestPoint, PointB=pull.ClosestPoint, Unitize=False)  # -> Vector, Length
number_slider_3 = Slider(2, range=0..10)
move_3 = Move(Geometry=move.Geometry, Motion=vec2pt_3.Vector)  # -> Geometry, Transform
merge = Merge(Data1=number_slider_3, Data2=Slider(4, range=0..10))
move_4 = Move(Geometry=move_3.Geometry, Motion=Z)  # -> Geometry, Transform
multiplication_2 = Multiplication(A=Z, B=graft(merge))
multiplication_3 = Multiplication(A=Z, B=number_slider_3)
boundary_3 = BoundarySurfaces(Edges=move_4.Geometry)
extr = Extrude(Base=boundary_2, Direction=Z)
extr_2 = Extrude(Base=boundary_3, Direction=Z)
move_5 = Move(Geometry=extr_2, Motion=multiplication_3)  # -> Geometry, Transform
move_6 = Move(Geometry=extr, Motion=multiplication_2)  # -> Geometry, Transform
merge_2 = Merge(Data1=extr_2, Data2=extr, Data3=move_5.Geometry, Data4=move_6.Geometry)  # -> flatten(Result)
sunion = SolidUnion(Breps=merge_2)
R = ClusterOutput(sunion)

# ==== cluster TowerStepped
upper_scale = Slider(0.7, range=0..1)
north = ClusterInput()
base_scale = Slider(0.8, range=0..1)
crv = ClusterInput()
crv_2 = Curve(crv)
north_2 = Point(north)
pcen = PolygonCenter(Polyline=crv_2)  # -> CenterV, CenterE, CenterA
num = ClusterInput()
sqr = Square(Value=upper_scale)
sqr_2 = Square(Value=base_scale)
scale = Scale(Geometry=crv_2, Center=pcen.CenterV, Factor=base_scale)  # -> Geometry, Transform
num_2 = Number(num)
floor = Slider(11, range=0..100)
multiplication = Multiplication(A=sqr_2, B=sqr)
boundary = BoundarySurfaces(Edges=scale.Geometry)
division = Division(A=num_2, B=multiplication)
multiplication_2 = Multiplication(A=division, B=floor)
division_2 = Division(A=multiplication_2, B=3)
Z = UnitZ(Factor=division_2)
move = Move(Geometry=scale.Geometry, Motion=Z)  # -> Geometry, Transform
explode = Explode(Curve=move.Geometry, Recursive=True)  # -> Segments, simplify(Vertices)
extr = Extrude(Base=boundary, Direction=Z)
pull = PullPoint(Point=north_2, Geometry=explode.Vertices, ClosestOnly=True)  # -> ClosestPoint, Distance
scale_2 = Scale(Geometry=move.Geometry, Center=flatten(pull.ClosestPoint), Factor=upper_scale)  # -> Geometry, Transform
Z_2 = UnitZ(Factor=division_2)
boundary_2 = BoundarySurfaces(Edges=scale_2.Geometry)
move_2 = Move(Geometry=scale_2.Geometry, Motion=Z_2)  # -> Geometry, Transform
extr_2 = Extrude(Base=boundary_2, Direction=Z_2)
explode_2 = Explode(Curve=move_2.Geometry, Recursive=True)  # -> Segments, Vertices
pull_2 = PullPoint(Point=pull.ClosestPoint, Geometry=explode_2.Vertices, ClosestOnly=True)  # -> ClosestPoint, Distance
scale_3 = Scale(Geometry=move_2.Geometry, Center=flatten(pull_2.ClosestPoint), Factor=upper_scale)  # -> Geometry, Transform
Z_3 = UnitZ(Factor=division_2)
boundary_3 = BoundarySurfaces(Edges=scale_3.Geometry)
extr_3 = Extrude(Base=boundary_3, Direction=Z_3)
brep = Brep(extr_2)
brep_2 = Brep(extr_3)
brep_3 = Brep(extr)
merge = Merge(Data1=brep_2, Data2=brep, Data3=brep_3)  # -> flatten(Result)
sunion = SolidUnion(Breps=merge)
R = ClusterOutput(sunion)
